# Grasshopper definition BodyArchitectures.gh (Grasshopper 0.9.76)

# ---- group: mirror the rail curves so modification remain symmetric
innercrv_0 = Curve(<curve referenced from the Rhino model>)
innercrv_1 = Curve(<curve referenced from the Rhino model>)
outercrv_0 = Curve(<curve referenced from the Rhino model>)
outercrv_1 = Curve(<curve referenced from the Rhino model>)
xz = XZPlane(Origin=Point(0, 0, 0))
xz_2 = XZPlane(Origin=Point(0, 0, 0))
xz_3 = XZPlane(Origin=Point(0, 0, 0))
xz_4 = XZPlane(Origin=Point(0, 0, 0))
mirror = Mirror(Geometry=innercrv_0, Plane=xz)  # -> Geometry, Transform
mirror_2 = Mirror(Geometry=innercrv_1, Plane=xz_2)  # -> Geometry, Transform
mirror_3 = Mirror(Geometry=outercrv_0, Plane=xz_3)  # -> Geometry, Transform
mirror_4 = Mirror(Geometry=outercrv_1, Plane=xz_4)  # -> Geometry, Transform
join = JoinCurves(Curves=[innercrv_0, mirror.Geometry], Preserve=False)
join_2 = JoinCurves(Curves=[innercrv_1, mirror_2.Geometry], Preserve=False)
join_3 = JoinCurves(Curves=[outercrv_0, mirror_3.Geometry], Preserve=False)
join_4 = JoinCurves(Curves=[outercrv_1, mirror_4.Geometry], Preserve=False)

# ---- group: stream out boundary curves
innercrv_0_2 = Curve(join)
innercrv_1_2 = Curve(join_2)
outercrv_0_2 = Curve(join_3)
outercrv_1_2 = Curve(join_4)
number_slider = Slider(99, range=0..100)
divide = DivideCurve(Curve=innercrv_0_2, Count=number_slider, Kinks=False)  # -> Points, Tangents, Parameters
divide_2 = DivideCurve(Curve=innercrv_1_2, Count=number_slider, Kinks=False)  # -> Points, Tangents, Parameters
divide_3 = DivideCurve(Curve=outercrv_0_2, Count=number_slider, Kinks=False)  # -> Points, Tangents, Parameters
divide_4 = DivideCurve(Curve=outercrv_1_2, Count=number_slider, Kinks=False)  # -> Points, Tangents, Parameters
innercrv_0_txt = Panel(divide.Points)
innercrv_1_txt = Panel(divide_2.Points)
outercrv_0_txt = Panel(divide_3.Points)
outercrv_1_txt = Panel(divide_4.Points)

# ---- group: stream profile curves
profile_0 = Curve(<curve referenced from the Rhino model>)
profile_1 = Curve(<curve referenced from the Rhino model>)
profile_2 = Curve(<curve referenced from the Rhino model>)
profile_3 = Curve(<curve referenced from the Rhino model>)
profile_4 = Curve(<curve referenced from the Rhino model>)
number_slider_2 = Slider(25, range=0..100)
divide_5 = DivideCurve(Curve=profile_0, Count=number_slider_2, Kinks=False)  # -> Points, Tangents, Parameters
divide_6 = DivideCurve(Curve=profile_1, Count=number_slider_2, Kinks=False)  # -> Points, Tangents, Parameters
divide_7 = DivideCurve(Curve=profile_2, Count=number_slider_2, Kinks=False)  # -> Points, Tangents, Parameters
divide_8 = DivideCurve(Curve=profile_3, Count=number_slider_2, Kinks=False)  # -> Points, Tangents, Parameters
divide_9 = DivideCurve(Curve=profile_4, Count=number_slider_2, Kinks=False)  # -> Points, Tangents, Parameters
profile_0_txt = Panel(divide_5.Points)
profile_1_txt = Panel(divide_6.Points)
profile_2_txt = Panel(divide_7.Points)
profile_3_txt = Panel(divide_8.Points)
profile_4_txt = Panel(divide_9.Points)
